# Grasshopper definition Coordinates.gh (Grasshopper 1.0.7)
# Copyright: Arup

crv = Curve(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)
crv_2 = Curve(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)

crv_3 = Curve(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)
crv_4 = Curve(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)
crv_5 = Curve(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)

crv_6 = Curve(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)
crv_7 = Curve(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)
crv_8 = Curve(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)

crv_9 = Curve(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)
crv_10 = Curve(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)
crv_11 = Curve(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)
crv_12 = Curve(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)
crv_13 = Curve(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)
crv_14 = Curve(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)
crv_15 = Curve(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)
panel = Panel("0")
curvetopts = CurveToPts(C=crv_4)
curvetopts_2 = CurveToPts(C=crv_5)
curvetopts_3 = CurveToPts(C=crv_3)
pt = Point([curvetopts, curvetopts_2, curvetopts_3])
subtraction = Subtraction(A=Slider(12, range=1..12), B="1")
curvetopts_4 = CurveToPts(C=crv_3)
curvetopts_5 = CurveToPts(C=crv_4)
curvetopts_6 = CurveToPts(C=crv_5)
panel_2 = Panel(subtraction)
item = ListItem(List=pt, Index=subtraction, Wrap=True)
panel_3 = Panel(curvetopts_4)
tester = CSharpScript(
    Points=curvetopts_5,
    Opening1Pts=curvetopts_6,
    Opening2Pts=curvetopts_4,
    Reference=["C:\Nicolaas\Repo\SpeckleStructural\Speckle2dMesher\bin\Debug\MathNet.Numerics.dll", "C:\Nicolaas\Repo\SpeckleStructural\Speckle2dMesher\bin\Debug\MathNet.Spatial.dll", "C:\Nicolaas\Repo\SpeckleStructural\Speckle2dMesher\bin\Debug\Speckle2dMesher.dll"])  # -> out, InternalLines; inputs Points: list of Point3d, Opening1Pts: list of Point3d, Opening2Pts: list of Point3d
# ---------- tester: C# usings ----------
using Speckle2dMesher;
# ---------- tester: C# ----------
    Print("Test");
    var ma = new MeshArea();


    var openingPointsList = new List<double[]>();
    if (Opening1Pts != null && Opening1Pts.Count > 0)
    {
      openingPointsList.Add(PointsToCoords(Opening1Pts));
    }
    if (Opening2Pts != null && Opening2Pts.Count > 0)
    {
      openingPointsList.Add(PointsToCoords(Opening2Pts));
    }

    ma.Init(PointsToCoords(Points), openingPointsList);

    var internalGlobalCoords = ma.GetInternalGlobalCoords();

    Print("Check");
    var lines = new List<Rhino.Geometry.Line>();
    foreach (var coords in internalGlobalCoords)
    {
      var pt1 = new Rhino.Geometry.Point3d(coords[0], coords[1], coords[2]);
      var pt2 = new Rhino.Geometry.Point3d(coords[3], coords[4], coords[5]);
      lines.Add(new Rhino.Geometry.Line(pt1, pt2));
    }

    InternalLines = lines;
    //var faces = ma.Faces();
# ---------- tester: C# additional code ----------
  private double[] PointsToCoords(List<Point3d> Points)
  {
    var vs = new List<double>();
    foreach (Point3d p in Points)
    {
      vs.Add(p.X);
      vs.Add(p.Y);
      vs.Add(p.Z);
    }
    return vs.ToArray();
  }
# ---------- end tester ----------
pt_2 = Point(item)
line = Line(tester.InternalLines)
panel_4 = Panel(tester.out)

# ==== cluster CurveToPts
C = ClusterInput()
explode = Explode(Curve=C, Recursive=True)  # -> Segments, Vertices
cullduppoints = RemoveDuplicatePoints(InputPoints=explode.Vertices, Tolerance=0.001)  # -> OutputPoints, FirstPointIndexes
clean = CleanTree(RemoveNulls=True, RemoveInvalid=True, RemoveEmpty=False, Tree=cullduppoints.OutputPoints)
pt = Point(clean)
pt_2 = ClusterOutput(pt)
